# Grasshopper definition inference.gh (Grasshopper 1.0.7)
# plug-ins: TT Toolbox

file_path = FilePath("C:\Users\HangTi\Documents\GitHub\MaskPLAN\graph.json")
ghpython_script = GhPythonScript(filepath=file_path)  # -> out, pdtype, pdlocation, pdroom, locs_x, locs_y, room_1, room_2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
# ---------- ghpython_script: Python ----------
import json
from datetime import datetime
with open(filepath,'r') as f:
    data = json.load(f)
pdtype = data['pdtype']
pdlocation = data['pdlocation']
pdroom = data['pdrooms']
names = ['None','Living','Bathroom','Storage/closet','Bed room','Kitchen','Dining','Balcony']

locs_x = pdlocation[:8]
locs_y = pdlocation[8:]
room_1 = pdroom[:8]
room_2 = pdroom[8:16]
room_3 = pdroom[16:24]
room_4 = pdroom[24:]
name_list = []
for i in range(8):
    if pdtype[i] != 8:
        name_list.append(names[pdtype[i]])
    else:
        len = i
        pdtype[i] = 0
print(datetime.now().strftime("%H:%M:%S"))
# ---------- end ghpython_script ----------
construct_point = ConstructPoint(XCoordinate=ghpython_script.room_3, YCoordinate=ghpython_script.room_4, ZCoordinate=0)
construct_point_2 = ConstructPoint(XCoordinate=ghpython_script.room_3, YCoordinate=ghpython_script.room_2, ZCoordinate=0)
split_list = SplitList(List=ghpython_script.name_list, Index=Slider(1, range=0..100))  # -> ListA, ListB
construct_point_3 = ConstructPoint(XCoordinate=ghpython_script.room_1, YCoordinate=ghpython_script.room_2, ZCoordinate=0)
construct_point_4 = ConstructPoint(XCoordinate=ghpython_script.room_1, YCoordinate=ghpython_script.room_4, ZCoordinate=0)
construct_point_5 = ConstructPoint(XCoordinate=ghpython_script.locs_x, YCoordinate=ghpython_script.locs_y, ZCoordinate=0)
merge = Merge(Data1=split_list.ListB, Data2=split_list.ListA)
circle_cnr = CircleCNR(Center=construct_point_5, Normal=Vector(0, 0, 1), Radius=Slider(4, range=0..10))
_4point_surface = _4PointSurface(CornerA=construct_point_4, CornerB=construct_point, CornerC=construct_point_2, CornerD=construct_point_3)
ghpython_script_2 = GhPythonScript(ind=Slider(2067, range=0..100000))  # -> out, a; inputs new: Int32, ind: Int32
# ---------- ghpython_script_2: Python ----------
import rhinoscriptsyntax as rs
import ghpythonlib.components as gc
import math
from Grasshopper.Kernel.Data import GH_Path
from Grasshopper import DataTree
from scriptcontext import sticky

a = r'D:\CVPR\excel_preprocessed_dataset\%d.xlsx' % (ind)
# ---------- end ghpython_script_2 ----------
rotate = Rotate(Geometry=circle_cnr, Angle=degrees("-90"), Plane=PlaneXY(0, 0, 0))  # -> Geometry, Transform
read_excel_sheet = ReadExcelSheet(Run=Toggle(True), FilePath=ghpython_script_2.a, Worksheet=Slider(4, range=0..10), Listen=False)  # -> UserMessages, Columns, Rows
rotate_2 = Rotate(Geometry=_4point_surface, Angle=degrees("-90"), Plane=PlaneXY(0, 0, 0))  # -> Geometry, Transform
list_item = ListItem(List=read_excel_sheet.Rows, Index=0, Wrap=True)  # -> flatten(Item), flatten(Item1)
construct_point_6 = ConstructPoint(XCoordinate=list_item.Item, YCoordinate=list_item.Item1, ZCoordinate=0)
series = Series(Start=0, Step=1, Count=ghpython_script.len)
scale = Scale(Geometry=rotate_2.Geometry, Center=Point(0, 0, 0), Factor=Slider(2, range=0..10))  # -> Geometry, Transform
polyline = PolyLine(Vertices=flatten(construct_point_6), Closed=True)
number_slider = Slider(10, range=0..10)
list_item_2 = ListItem(List=scale.Geometry, Index=series, Wrap=True)
curve = Curve(polyline)
split_list_2 = SplitList(List=list_item_2, Index=Slider(1, range=0..100))  # -> ListA, ListB
scale_2 = Scale(Geometry=curve, Center=Point(0, 0, 0), Factor=0.5)  # -> Geometry, Transform
xz_plane = XZPlane(Origin=Point(0, 0, 0))
merge_2 = Merge(Data1=split_list_2.ListB, Data2=split_list_2.ListA)
deconstruct_brep = DeconstructBrep(Brep=merge_2)  # -> Faces, Edges, simplify(Vertices)
sort_points = SortPoints(Points=deconstruct_brep.Vertices)  # -> Points, Indices
list_item_3 = ListItem(List=sort_points.Points, Index=0, Wrap=True)  # -> flatten(Item), flatten(Item1), flatten(Item2), flatten(Item3)
number_slider_2 = Slider(3.5, range=0..10)
mirror = Mirror(Geometry=scale_2.Geometry, Plane=xz_plane)  # -> Geometry, Transform
scale_3 = Scale(Geometry=mirror.Geometry, Center=Point(0, 0, 0), Factor=Slider(2, range=0..10))  # -> Geometry, Transform
offset_curve = OffsetCurve(Curve=scale_3.Geometry, Distance=Slider(1.5, range=0..10), Corners=1)
ghpython_script_3 = GhPythonScript(
    typelist=ghpython_script.pdtype,
    room_1=list_item_3.Item,
    room_2=list_item_3.Item2,
    room_3=list_item_3.Item3,
    room_4=list_item_3.Item1,
    Bound=offset_curve,
    Bound_in=offset_curve,
    threshold=Slider(10, range=0..100))  # -> InCollections, MidCollections, OutCollections; inputs typelist: list of Int32, room_1: list of Point3d, room_2: list of Point3d, room_3: list of Point3d, room_4: list of Point3d, Bound: Polyline, Bound_in: Polyline
# ---------- ghpython_script_3: Python ----------
import rhinoscriptsyntax as rs
import ghpythonlib.components as gc
import math

#width = scale_list[1] - scale_list[0]
#height = scale_list[3] - scale_list[2]
#dimension = max(width,height)
scale = (255/18)**2#*(dimension/255)
namelist = ['Entray','Bathroom','Closet','Bed','Kitchen','Dining','Balcony']
names = []

def GetInnerBox(x,y,area,ratio):
    x_dimension = ((math.sqrt(scale*area/ratio))/2)
    y_dimension = (x_dimension*ratio)
    Pt_01 = gc.ConstructPoint(x-x_dimension,y-y_dimension,0)
    Pt_02 = gc.ConstructPoint(x+x_dimension,y-y_dimension,0)
    Pt_03 = gc.ConstructPoint(x+x_dimension,y+y_dimension,0)
    Pt_04 = gc.ConstructPoint(x-x_dimension,y+y_dimension,0)
    Inner_Box = [Pt_01,Pt_02,Pt_03,Pt_04]
    
    return Inner_Box

def GetMidBox(PtAll):
    Pt_11 = gc.Move(PtAll[0],'-1.5,-1.5,0')[0]
    Pt_12 = gc.Move(PtAll[1],'+1.5,-1.5,0')[0]
    Pt_13 = gc.Move(PtAll[2],'+1.5,+1.5,0')[0]
    Pt_14 = gc.Move(PtAll[3],'-1.5,+1.5,0')[0]
    Mid_Box = [Pt_11,Pt_12,Pt_13,Pt_14]
    
    return Mid_Box

def CalculateDistance(Corner,target):
    Down_Pt = gc.ProjectPoint(Corner,'0,-1,0',target)[0]
    Left_Pt = gc.ProjectPoint(Corner,'-1,0,0',target)[0]
    Up_Pt = gc.ProjectPoint(Corner,'0,1,0',target)[0]
    Right_Pt = gc.ProjectPoint(Corner,'1,0,0',target)[0]
    Dis_Down = gc.Distance(Corner,Down_Pt)
    Dis_Left = gc.Distance(Corner,Left_Pt)
    Dis_Up = gc.Distance(Corner,Up_Pt)
    Dis_Right = gc.Distance(Corner,Right_Pt)

    return Dis_Down,Dis_Left,Dis_Up,Dis_Right

def ModifyCorners(Dis_D,Dis_L,Dis_U,Dis_R,Index_a,Index_b,Index_d,PtAll):
    if 0.01< Dis_D < threshold + 0.01:
        PtAll[Index_a] = gc.Move(PtAll[Index_a],'0,-%f,0' % (Dis_D))[0]
        PtAll[Index_b] = gc.Move(PtAll[Index_b],'0,-%f,0' % (Dis_D))[0]
    if 0.01< Dis_L < threshold + 0.01:
        PtAll[Index_a] = gc.Move(PtAll[Index_a],'-%f,0,0' % (Dis_L))[0]
        PtAll[Index_d] = gc.Move(PtAll[Index_d],'-%f,0,0' % (Dis_L))[0]
    if 0.01< Dis_U < threshold + 0.01:
        PtAll[Index_a] = gc.Move(PtAll[Index_a],'0,%f,0' % (Dis_U))[0]
        PtAll[Index_b] = gc.Move(PtAll[Index_b],'0,%f,0' % (Dis_U))[0]
    if 0.01< Dis_R < threshold + 0.01:
        PtAll[Index_a] = gc.Move(PtAll[Index_a],'%f,0,0' % (Dis_R))[0]
        PtAll[Index_d] = gc.Move(PtAll[Index_d],'%f,0,0' % (Dis_R))[0]
    return PtAll

def GetCurve_init(Mid_Ptlist):
    Mid = gc.PolyLine([Mid_Ptlist[0],Mid_Ptlist[1],Mid_Ptlist[2],Mid_Ptlist[3]],True)
    Inner = gc.OffsetCurve(Mid,-1.5,gc.XYPlane('0,0,0'),1)
    Outer = gc.OffsetCurve(Mid,1.5,gc.XYPlane('0,0,0'),1)
    
    Inner_Cut = gc.RegionIntersection(Inner,Bound_in,gc.XYPlane('0,0,0'))
#    Outer_Cut = gc.RegionIntersection(Outer,Bound_in,gc.XYPlane('0,0,0'))
    return Inner_Cut,Mid,Outer

def GetCurve_rest(Mid_Ptlist,blocked):
    Mid = gc.PolyLine([Mid_Ptlist[0],Mid_Ptlist[1],Mid_Ptlist[2],Mid_Ptlist[3]],True)
    Mid_cut = gc.RegionIntersection(Mid,Bound,gc.XYPlane('0,0,0'))
    Mid_blocked = gc.RegionDifference(Mid_cut,blocked)
    Inner = gc.OffsetCurve(Mid_blocked,-1.5,gc.XYPlane('0,0,0'),1)
    Outer = gc.OffsetCurve(Mid_blocked,1.5,gc.XYPlane('0,0,0'),1)
    
#    Inner_Cut = gc.RegionIntersection(Inner,Bound_in,gc.XYPlane('0,0,0'))
#    Outer_Cut = gc.RegionIntersection(Outer,Bound_in,gc.XYPlane('0,0,0'))
    return Inner,Mid_blocked,Outer

InCollections = []
MidCollections = []
OutCollections = []

for m in range(8):
    if typelist[m] != 0:
        n = [room_1[m],room_2[m],room_3[m],room_4[m]]#GetInnerBox(Center_x[m],Center_y[m],Area[m],Aspect_Ratio[m])
        MidPt = GetMidBox(n)
        if m == 0:
            for i,j in enumerate(MidPt):
                DisD,DisL,DisU,DisR = CalculateDistance(j,Bound)
                if i == 0:
                    MidPt = ModifyCorners(DisD,DisL,DisU,DisR,0,1,3,MidPt)
                elif i == 1:
                    MidPt = ModifyCorners(DisD,DisL,DisU,DisR,1,0,2,MidPt)
                elif i == 2:
                    MidPt = ModifyCorners(DisD,DisL,DisU,DisR,2,3,1,MidPt)
                elif i == 3:
                    MidPt = ModifyCorners(DisD,DisL,DisU,DisR,3,2,0,MidPt)
            In,Mid,Out = GetCurve_init(MidPt)
            InCollections.append(In)
            MidCollections.append(Mid)
            OutCollections.append(Out)
        else:
            for i,j in enumerate(MidPt):
                DisD1,DisL1,DisU1,DisR1 = CalculateDistance(j,Bound)
                if i == 0:
                    MidPt = ModifyCorners(DisD1,DisL1,DisU1,DisR1,0,1,3,MidPt)
                elif i == 1:
                    MidPt = ModifyCorners(DisD1,DisL1,DisU1,DisR1,1,0,2,MidPt)
                elif i == 2:
                    MidPt = ModifyCorners(DisD1,DisL1,DisU1,DisR1,2,3,1,MidPt)
                elif i == 3:
                    MidPt = ModifyCorners(DisD1,DisL1,DisU1,DisR1,3,2,0,MidPt)
    
            for i,j in enumerate(MidPt):
                DisD1,DisL1,DisU1,DisR1 = CalculateDistance(j,Bound)
                DisD2,DisL2,DisU2,DisR2 = CalculateDistance(j,MidCollections)
                if i == 0:
                    MidPt = ModifyCorners(DisD1,DisL1,DisU1,DisR1,0,1,3,MidPt)
                    MidPt = ModifyCorners(DisD2,DisL2,DisU2,DisR2,0,1,3,MidPt)
                elif i == 1:
                    MidPt = ModifyCorners(DisD1,DisL1,DisU1,DisR1,1,0,2,MidPt)
                    MidPt = ModifyCorners(DisD2,DisL2,DisU2,DisR2,1,0,2,MidPt)
                elif i == 2:
                    MidPt = ModifyCorners(DisD1,DisL1,DisU1,DisR1,2,3,1,MidPt)
                    MidPt = ModifyCorners(DisD2,DisL2,DisU2,DisR2,2,3,1,MidPt)
                elif i == 3:
                    MidPt = ModifyCorners(DisD1,DisL1,DisU1,DisR1,3,2,0,MidPt)
                    MidPt = ModifyCorners(DisD2,DisL2,DisU2,DisR2,3,2,0,MidPt)
            
            In,Mid,Out = GetCurve_rest(MidPt,MidCollections)
            if m == 3: aa = In
            InCollections.append(In)
            MidCollections.append(Mid)
            OutCollections.append(Out)
# ---------- end ghpython_script_3 ----------
curve_2 = Curve(ghpython_script_3.InCollections)
area = Area(Geometry=curve_2)  # -> Area, Centroid
offset_curve_2 = OffsetCurve(Curve=scale_3.Geometry, Distance=Slider(5, range=0..10), Corners=1)
text_tag_3d = TextTag3D(Location=area.Centroid, Text=merge, Size=Slider(3, range=0..10), Justification=7)
